# Grasshopper definition HB-PB.gh (Grasshopper 0.9.76)
# plug-ins: Python Interpreter, PassiveBee

honeybee = Honeybee_Honeybee()  # -> Vviiiiiiiiiizzz; plug-in component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
ladybug = Ladybug_Ladybug()  # -> Vviiiiiiiiiizzz; plug-in component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
box = DomainBox(Base=PlaneXY(0, 0, 0), X=Domain(-2, 2), Y=Domain(0, 5), Z=Domain(0, 3))
mass2zone = Honeybee_Masses2Zones(isConditioned=True, maxRoofAngle=30)  # -> readMe, HBZones; plug-in component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
mass2zone_2 = Honeybee_Masses2Zones(zoneMasses=flatten(box), isConditioned=True, maxRoofAngle=30, createHBZones=Toggle(True))  # -> readMe, HBZones; plug-in component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
panel = Panel("""[HBID, 1c43d7f7-a564-40aa-92e1-bc76bbc0dabb_76e347a8-363a-4511-91dd-5705c83c1a99
0f3168b3-1163-4061-bc72-66c21138ebd1""")
c_script = CSharpScript(x=mass2zone_2.HBZones)  # -> out, A, B; inputs x: Brep
# ---------- c_script: C# ----------
    var testSticky = Rhino.Runtime.PythonScript.Create();
    string pyScript = "import scriptcontext as sc;";
    pyScript += "hb_hive = sc.sticky['HBHive']";
    pyScript += "['1c43d7f7-a564-40aa-92e1-bc76bbc0dabb_76e347a8-363a-4511-91dd-5705c83c1a99']['0f3168b3-1163-4061-bc72-66c21138ebd1']";
    
    var backFromPython = testSticky.EvaluateExpression(
      pyScript
      , "hb_hive");

    B = x.UserDictionary;

    A = backFromPython;
# ---------- end c_script ----------
makeadiabaticbyname = Honeybee_MakeAdiabaticByName(HBObjs=mass2zone_2.HBZones, byName="dd")  # -> HBObjs; plug-in component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
panel_2 = Panel(c_script.out)
panel_3 = Panel(c_script.B)
panel_4 = Panel(c_script.A)
c_script_2 = CSharpScript(x=mass2zone_2.HBZones)  # -> out, A
# ---------- c_script_2: C# ----------
    
    A = x.GetType();
# ---------- end c_script_2 ----------
python = PythonScript(x=mass2zone_2.HBZones)  # -> out, a; inputs x: Brep
# ---------- python: Python ----------
import scriptcontext as sc
sc.sticky['PassiveBee'] = "ttttttt"
a= sc.sticky['HBHive']['1c43d7f7-a564-40aa-92e1-bc76bbc0dabb_76e347a8-363a-4511-91dd-5705c83c1a99']['0f3168b3-1163-4061-bc72-66c21138ebd1']
print  x.UserDictionary['HBID']
# ---------- end python ----------
passivebeenickname = PassiveBee(Surfaces=flatten(box))
makeadiabaticbytype = Honeybee_MakeAdiabaticByType()  # -> HBZones; plug-in component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
panel_5 = Panel(python.a)
panel_6 = Panel(c_script_2.A)
exporttoopenstudio = Honeybee_ExportToOpenStudio()  # -> readMe, osmFileAddress, idfFileAddress, resultFileAddress, eioFileAddress, rddFileAddress, htmlReport, studyFolder; plug-in component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
panel_7 = Panel(passivebeenickname)
decomposebytype = Honeybee_DecomposeBasedOnType()  # -> walls, interiorWalls, airWalls, windows, interiorWindows, skylights, roofs, ceilings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; plug-in component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
