# Grasshopper definition 01_TalkToHB.gh (Grasshopper 0.9.76)
# plug-ins: Python Interpreter, PassiveBee

box = DomainBox(Base=PlaneXY(0, 0, 0), X=Domain(-2, 2), Y=Domain(-0.5, 0.5), Z=Domain(0, 0.25))
box_2 = DomainBox(Base=PlaneXY(0, 0, 0), X=Domain(-2, 2), Y=Domain(-0.5, 0.5), Z=Domain(0, 0.25))
ladybug = Ladybug_Ladybug()  # -> Vviiiiiiiiiizzz; plug-in component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
honeybee = Honeybee_Honeybee()  # -> Vviiiiiiiiiizzz; plug-in component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
mass2zone = Honeybee_Masses2Zones(zoneMasses=flatten([box_2, box]), isConditioned=True, maxRoofAngle=30, createHBZones=Toggle(True))  # -> readMe, HBZones; plug-in component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
passivebeenickname = PassiveBee()
python = PythonScript(x=mass2zone.HBZones)  # -> out, a; inputs x: list of Brep
# ---------- python: Python ----------
import scriptcontext as sc
#sc.sticky['PassiveBee'] = "ttttttt"
#a= sc.sticky['HBHive']['1c43d7f7-a564-40aa-92e1-bc76bbc0dabb_76e347a8-363a-4511-91dd-5705c83c1a99']['0f3168b3-1163-4061-bc72-66c21138ebd1']
oo = [];
for i in x:
    oo.append(i.UserDictionary['HBID'])
a =oo
print oo;
# ---------- end python ----------
panel = Panel(passivebeenickname)
panel_2 = Panel(python.a)
