# Grasshopper definition 02_GetHBObjectInfo.gh (Grasshopper 0.9.76)
# plug-ins: Python Interpreter, PassiveBee

rectangle = Rectangle(Plane=PlaneXY(0, 0, 0), XSize=Domain(-1, 1), YSize=Domain(-2, 2), Radius=0)  # -> Rectangle, Length
toggle = BooleanToggle(True)
box = DomainBox(Base=PlaneXY(0, 0, 0), X=Domain(-2, 2), Y=Domain(-0.5, 0.5), Z=Domain(0, 0.25))
box_2 = DomainBox(Base=PlaneXY(0, 0, 0), X=Domain(-2, 2), Y=Domain(-0.5, 0.5), Z=Domain(0, 0.25))
honeybee = Honeybee_Honeybee()  # -> Vviiiiiiiiiizzz; plug-in component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
ladybug = Ladybug_Ladybug()  # -> Vviiiiiiiiiizzz; plug-in component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
boundary = BoundarySurfaces(Edges=rectangle.Rectangle)
mass2zone = Honeybee_Masses2Zones(zoneMasses=flatten([box, box_2]), isConditioned=True, maxRoofAngle=30, createHBZones=toggle)  # -> readMe, HBZones; plug-in component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
createhbsrfs = Honeybee_createHBSrfs(geometry=boundary)  # -> readMe, simplify(HBSurface); plug-in component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
glazingcreator = Honeybee_GlazingBasedOnRatio(HBObjects=mass2zone.HBZones, glzRatio=Slider(0.8, range=0..1), runIt=toggle)  # -> readMe, HBObjWGLZ; plug-in component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
runenergysimulation = Honeybee_RunEnergySimulation()  # -> report, idfFileAddress, htmlReport, resultFileAddress; plug-in component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
passivebeenickname = PassiveBee()  # -> Out, Json
c_script = CSharpScript(x=glazingcreator.HBObjWGLZ)  # -> out, A, B; inputs x: Brep
# ---------- c_script: C# ----------
    var inBrep = x;
    var HBID = (inBrep.UserDictionary["HBID"] as string).Split('#');
    string baseKey = HBID[0];
    string key = HBID[1];

    var testSticky = Rhino.Runtime.PythonScript.Create();
    //testSticky.SetVariable("points", "a");
    string pyScript = "import scriptcontext as sc;";
    pyScript += @"HBO = sc.sticky['HBHive']['" + baseKey + "']['" + key + "'];";
    pyScript += "points=[];";
    pyScript += "\nif HBO.objectType == 'HBZone':";
    pyScript += "\n for HBS in HBO.surfaces:";
    pyScript += "   points.append(HBS.extractPoints(1, True))";

    //pyScript += "\npoints = [];\n\nHBO= HBObjectsFromHive;\n  if HBO.objectType == 'HBZone':\n    for HBS in HBO.surfaces:\n      points.append(HBS.extractPoints(1, True))\n    else:\n        points= HBO.extractPoints(1, True)\n";
    //pyScript += "points = []"+"\n"+
    //           "if 1==1: "+"\n"+
    //           " points.append(1)";


    testSticky.ExecuteScript(pyScript);
    //pyScript += "zone = hb_hive.visualizeFromHoneybeeHive(["+x+"])[0]";
    var backFromPython = testSticky.GetVariable("points") as IList<object>;
    //List<string> result = ((IList<object>)backFromPython.Invoke(method)).Cast<string>().ToList();
    //var backFromPython = testSticky.EvaluateExpression(pyScript, "points");

    B = x.UserDictionary;

    A = backFromPython;
# ---------- end c_script ----------
panel = Panel("surface.extractPoints()")
zones = Panel("""#reEvaluate = hb_reEvaluateHBZones(HBO)
        #reEvaluate.evaluateZones()
        checkZoneSurface()""")
python = PythonScript(x=glazingcreator.HBObjWGLZ)  # -> out, a; inputs x: list of Brep
# ---------- python: Python ----------
import scriptcontext as sc
import json
from pprint import pprint

# call the objects from the lib
hb_hive = sc.sticky["honeybee_Hive"]()
hb_reEvaluateHBZones= sc.sticky["honeybee_reEvaluateHBZones"]
HBObjectsFromHive = hb_hive.callFromHoneybeeHive(x)

points = []

for HBO in HBObjectsFromHive:
    if HBO.objectType == 'HBZone':
        
        #reEvaluate = hb_reEvaluateHBZones(HBO)
        #reEvaluate.evaluateZones()
        for HBS in HBO.surfaces:
            
            #pprint (help(HBS))
            points.extend(HBS.extractPoints(1, True))
    else:
        points= HBO.extractPoints(1, True)
        
#print points;
a= points
#a = json.dumps(points)
    #print HBO.getFloorArea()
    #print HBO.getZoneVolume()
    #for HBS in HBO.surfaces:
    #    print "----------------"
    #    #print HBS.getTotalArea()
    #    print "-----------------"
    #    print HBS
    #    print HBS.getOpaqueArea()
    #    print HBS.getWWR()
# ---------- end python ----------
# if HBObject.objectType != "HBZone" and HBObject.hasChild:
#                     # Honeybee surface with openings
#                     if HBObject.punchedGeometry == None:
#                         HBObject.calculatePunchedSurface()
# 
#                     geometries = [childObject.geometry for childObject in HBObject.childSrfs]
#                     geometries.append(HBObject.punchedGeometry)
#                     # join geometries into a single surface
#                     geometry = rc.Geometry.Brep.JoinBreps(geometries, sc.doc.ModelAbsoluteTolerance)[0]
# 
#                 elif HBObject.objectType == "HBZone":
#                     srfs = []
#                     zoneHasChildSrf = False
#                     for HBSrf in HBObject.surfaces:
#                         if HBSrf.hasChild:
#                             zoneHasChildSrf = True
#                             srfs.append(HBSrf.punchedGeometry)
#                             for childObject in HBSrf.childSrfs:
#                                 srfs.append(childObject.geometry)
#                         else:
#                             srfs.append(HBSrf.geometry)
# 
#                     if zoneHasChildSrf:
#                         geometry = rc.Geometry.Brep.JoinBreps(srfs, sc.doc.ModelAbsoluteTolerance)[0]
#                     else:
#                         geometry = HBObject.geometry
#                 else:
#                     # if there is not child object use the geometry as it is
#                     geometry = HBObject.geometry
panel_2 = Panel(passivebeenickname.Out)
panel_3 = Panel(c_script.out)
panel_4 = Panel(c_script.A)
makeadiabaticbyname = Honeybee_MakeAdiabaticByName()  # -> HBObjs; plug-in component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
panel_5 = Panel(python.a)
panel_6 = Panel(python.out)
