# Grasshopper definition 03_GetHBObjectsInfo.gh (Grasshopper 0.9.76)
# plug-ins: Python Interpreter, PassiveBee

rectangle = Rectangle(Plane=PlaneXY(0, 0, 0), XSize=Domain(-1, 1), YSize=Domain(-2, 2), Radius=0)  # -> Rectangle, Length
toggle = BooleanToggle(True)
box = DomainBox(Base=PlaneXY(0, 0, 0), X=Domain(-2, 2), Y=Domain(-0.5, 0.5), Z=Domain(0, 0.25))
box_2 = DomainBox(Base=PlaneXY(0, 0, 0), X=Domain(-2, 2), Y=Domain(-0.5, 0.5), Z=Domain(0, 0.25))
honeybee = Honeybee_Honeybee()  # -> Vviiiiiiiiiizzz; plug-in component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
ladybug = Ladybug_Ladybug()  # -> Vviiiiiiiiiizzz; plug-in component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
boundary = BoundarySurfaces(Edges=rectangle.Rectangle)
mass2zone = Honeybee_Masses2Zones(zoneMasses=flatten([box, box_2]), isConditioned=True, maxRoofAngle=30, createHBZones=toggle)  # -> readMe, HBZones; plug-in component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
createhbsrfs = Honeybee_createHBSrfs(geometry=boundary)  # -> readMe, simplify(HBSurface); plug-in component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
panel = Panel(ladybug)
glazingcreator = Honeybee_GlazingBasedOnRatio(HBObjects=mass2zone.HBZones, glzRatio=Slider(0.8, range=0..1), runIt=toggle)  # -> readMe, HBObjWGLZ; plug-in component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
passivebeenickname = PassiveBee(Surfaces=flatten(glazingcreator.HBObjWGLZ))  # -> Out, Json, Srfs
runenergysimulation = Honeybee_RunEnergySimulation()  # -> report, idfFileAddress, htmlReport, resultFileAddress; plug-in component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
getkey = PythonScript(x=glazingcreator.HBObjWGLZ)  # -> out, a; inputs x: list of Brep
# ---------- getkey: Python ----------
import scriptcontext as sc
import json
from pprint import pprint

ids = [];
idsString =""
for item in x:
    id = item.UserDictionary["HBID"];
    idsString += id+"','"
    ids.append("['"+id +"']")

a = "['"+idsString[:-2]+"]";
print a
# ---------- end getkey ----------
c_script = CSharpScript()  # -> out, A, B, C; inputs x: String
# ---------- c_script: C# ----------
    
    string HBIDsString = x;

    
    
    var pyRun = Rhino.Runtime.PythonScript.Create();
    //testSticky.SetVariable("points", "a");
    string pyScript = "";
    pyScript += "import scriptcontext as sc;";
    pyScript += "PyHBObjects=[];";
    pyScript += string.Format("HBIDs={0};", HBIDsString);
    pyScript += @"for HBID in HBIDs:";
    pyScript += " PyHBObjects.append(HBID);";
    //pyScript += " PyHBObjects.append(sc.sticky['HBHive']HBID);";
    pyRun.ExecuteScript(pyScript);
    var HBObjects = pyRun.GetVariable("PyHBObjects") as IList<dynamic>;


    //List<string> result = ((IList<object>)backFromPython.Invoke(method)).Cast<string>().ToList();
    //var backFromPython = testSticky.EvaluateExpression(pyScript, "points");
    //C = backFromPythonAsObj;
    //B = x.UserDictionary;

    A = HBObjects;
# ---------- end c_script ----------
python = PythonScript(x=glazingcreator.HBObjWGLZ)  # -> out, a; inputs x: list of Brep
# ---------- python: Python ----------
import scriptcontext as sc
import json
from pprint import pprint

# call the objects from the lib
hb_hive = sc.sticky["honeybee_Hive"]()
hb_reEvaluateHBZones= sc.sticky["honeybee_reEvaluateHBZones"]
HBObjectsFromHive = hb_hive.callFromHoneybeeHive(x)

points = []

for HBO in HBObjectsFromHive:
    if HBO.objectType == 'HBZone':
        pprint (help(HBO))
        #reEvaluate = hb_reEvaluateHBZones(HBO)
        #reEvaluate.evaluateZones()
        for HBS in HBO.surfaces:
            
            #pprint (help(HBS))
            points.extend(HBS.extractPoints(1, True))
    else:
        points= HBO.extractPoints(1, True)
        
#print points;
a= points
#a = json.dumps(points)
    #print HBO.getFloorArea()
    #print HBO.getZoneVolume()
    #for HBS in HBO.surfaces:
    #    print "----------------"
    #    #print HBS.getTotalArea()
    #    print "-----------------"
    #    print HBS
    #    print HBS.getOpaqueArea()
    #    print HBS.getWWR()
# ---------- end python ----------
# if HBObject.objectType != "HBZone" and HBObject.hasChild:
#                     # Honeybee surface with openings
#                     if HBObject.punchedGeometry == None:
#                         HBObject.calculatePunchedSurface()
# 
#                     geometries = [childObject.geometry for childObject in HBObject.childSrfs]
#                     geometries.append(HBObject.punchedGeometry)
#                     # join geometries into a single surface
#                     geometry = rc.Geometry.Brep.JoinBreps(geometries, sc.doc.ModelAbsoluteTolerance)[0]
# 
#                 elif HBObject.objectType == "HBZone":
#                     srfs = []
#                     zoneHasChildSrf = False
#                     for HBSrf in HBObject.surfaces:
#                         if HBSrf.hasChild:
#                             zoneHasChildSrf = True
#                             srfs.append(HBSrf.punchedGeometry)
#                             for childObject in HBSrf.childSrfs:
#                                 srfs.append(childObject.geometry)
#                         else:
#                             srfs.append(HBSrf.geometry)
# 
#                     if zoneHasChildSrf:
#                         geometry = rc.Geometry.Brep.JoinBreps(srfs, sc.doc.ModelAbsoluteTolerance)[0]
#                     else:
#                         geometry = HBObject.geometry
#                 else:
#                     # if there is not child object use the geometry as it is
#                     geometry = HBObject.geometry
c_script_2 = CSharpScript()  # -> out, A
# ---------- c_script_2: C# ----------
    var pyRun = Rhino.Runtime.PythonScript.Create();
    int [] HBIDs = new int[]{1, 2, 3};
    pyRun.SetVariable("HBIDs", HBIDs);
string pyScript = @"
import rhinoscriptsyntax as rs;
aa = []
for item in HBIDs:
  aa.append(item);
      ";
    pyRun.ExecuteScript(pyScript);

    var HBObjects = pyRun.GetVariable("aa");

    A = HBObjects;
# ---------- end c_script_2 ----------
panel_2 = Panel(c_script_2.A)
panel_3 = Panel(getkey.a)
panel_4 = Panel(c_script.A)
panel_5 = Panel("surface.extractPoints()")
zones = Panel("""#reEvaluate = hb_reEvaluateHBZones(HBO)
        #reEvaluate.evaluateZones()
        checkZoneSurface()""")
panel_6 = Panel(python.a)
panel_7 = Panel("""		__dict__	{IronPython.Runtime.PythonDictionary}	IronPython.Runtime.PythonDictionary
		__doc__	"..."	System.String
+		__init__	{IronPython.Runtime.Method}	IronPython.Runtime.Method
		__module__	"__main__"	System.String
+		__str__	{IronPython.Runtime.Method}	IronPython.Runtime.Method
+		addChildSrf	{IronPython.Runtime.Method}	IronPython.Runtime.Method
		angle2North	180	System.Double
		basePlane	{Origin=0,-0.5,0.125 XAxis=0,0,-1, YAxis=1,0,0, ZAxis=0,-1,0}	Rhino.Geometry.Plane
		BC	"Outdoors"	System.String
+		BCObject	{IronPython.NewTypes.System.Object_2$2}	IronPython.NewTypes.System.Object_2$2
+		calculatePunchedSurface	{IronPython.Runtime.Method}	IronPython.Runtime.Method
		cenPt	{0,-0.5,0.125}	Rhino.Geometry.Point3d
+		checkForInternalEdge	{IronPython.Runtime.Method}	IronPython.Runtime.Method
+		checkPlanarity	{IronPython.Runtime.Method}	IronPython.Runtime.Method
		childSrfs	{IronPython.Runtime.List}	IronPython.Runtime.List
		cnstrSet	{IronPython.Runtime.PythonDictionary}	IronPython.Runtime.PythonDictionary
+		collectMeshFaces	{IronPython.Runtime.Method}	IronPython.Runtime.Method
		construction	"Exterior Wall"	System.String
		containsPVgen	false	System.Boolean
+		disposeCurrentMeshes	{IronPython.Runtime.Method}	IronPython.Runtime.Method
		EPConstruction	"Exterior Wall"	System.String
+		extractGlzPoints	{IronPython.Runtime.Method}	IronPython.Runtime.Method
+		extractMeshPts	{IronPython.Runtime.Method}	IronPython.Runtime.Method
+		extractPoints	{IronPython.Runtime.Method}	IronPython.Runtime.Method
+		findDiscontinuity	{IronPython.Runtime.Method}	IronPython.Runtime.Method
		geometry	{Rhino.Geometry.Brep}	Rhino.Geometry.Brep
+		getAngle2North	{IronPython.Runtime.Method}	IronPython.Runtime.Method
+		getArea	{IronPython.Runtime.Method}	IronPython.Runtime.Method
+		getGlazingArea	{IronPython.Runtime.Method}	IronPython.Runtime.Method
+		getOpaqueArea	{IronPython.Runtime.Method}	IronPython.Runtime.Method
+		getSrfCenPtandNormalAlternate	{IronPython.Runtime.Method}	IronPython.Runtime.Method
+		getTotalArea	{IronPython.Runtime.Method}	IronPython.Runtime.Method
+		getTypeByNormalAngle	{IronPython.Runtime.Method}	IronPython.Runtime.Method
+		getWWR	{IronPython.Runtime.Method}	IronPython.Runtime.Method
		groundViewFactor	"autocalculate"	System.String
		hasChild	true	System.Boolean
		hasInternalEdge	false	System.Boolean
		ID	"0b5329ec-d4c9-426f-aa2a-0b52a1af820c"	System.String
		intCnstrSet	{IronPython.Runtime.PythonDictionary}	IronPython.Runtime.PythonDictionary
+		isAntiClockWise	{IronPython.Runtime.Method}	IronPython.Runtime.Method
		isChild	false	System.Boolean
+		isOnGrade	{IronPython.Runtime.Method}	IronPython.Runtime.Method
		isPlanar	true	System.Boolean
+		isPossibleChild	{IronPython.Runtime.Method}	IronPython.Runtime.Method
+		isRectangle	{IronPython.Runtime.Method}	IronPython.Runtime.Method
+		isUnderground	{IronPython.Runtime.Method}	IronPython.Runtime.Method
		meshedFace	{Rhino.Geometry.Mesh}	Rhino.Geometry.Mesh
		name	"zone_0_Srf_0"	System.String
		normalVector	{0,-1,0}	Rhino.Geometry.Vector3d
		num	0	System.Int32
		numOfVertices	"autocalculate"	System.String
		objectType	"HBSurface"	System.String
+		outdoorBCObject	{IronPython.Runtime.Types.PythonType}	IronPython.Runtime.Types.PythonType
+		parent	{IronPython.NewTypes.System.Object_2$2}	IronPython.NewTypes.System.Object_2$2
		punchedGeometry	{Rhino.Geometry.Brep}	Rhino.Geometry.Brep
		PVgenlist	{IronPython.Runtime.List}	IronPython.Runtime.List
+		reEvaluateType	{IronPython.Runtime.Method}	IronPython.Runtime.Method
+		removeAllChildSrfs	{IronPython.Runtime.Method}	IronPython.Runtime.Method
+		resetID	{IronPython.Runtime.Method}	IronPython.Runtime.Method
+		setBC	{IronPython.Runtime.Method}	IronPython.Runtime.Method
+		setBCObject	{IronPython.Runtime.Method}	IronPython.Runtime.Method
+		setBCObjectToOutdoors	{IronPython.Runtime.Method}	IronPython.Runtime.Method
+		setEPConstruction	{IronPython.Runtime.Method}	IronPython.Runtime.Method
+		setName	{IronPython.Runtime.Method}	IronPython.Runtime.Method
+		setRADMaterial	{IronPython.Runtime.Method}	IronPython.Runtime.Method
+		setSunExposure	{IronPython.Runtime.Method}	IronPython.Runtime.Method
+		setType	{IronPython.Runtime.Method}	IronPython.Runtime.Method
+		setWindExposure	{IronPython.Runtime.Method}	IronPython.Runtime.Method
		shdCntrlZoneInstructs	{IronPython.Runtime.List}	IronPython.Runtime.List
		srfBC	{IronPython.Runtime.PythonDictionary}	IronPython.Runtime.PythonDictionary
		srfBCByUser	false	System.Boolean
		srfSunExposure	{IronPython.Runtime.PythonDictionary}	IronPython.Runtime.PythonDictionary
		srfType	{IronPython.Runtime.PythonDictionary}	IronPython.Runtime.PythonDictionary
		srfTypeByUser	false	System.Boolean
		srfWindExposure	{IronPython.Runtime.PythonDictionary}	IronPython.Runtime.PythonDictionary
		sunExposure	"SunExposed"	System.String
+		transform	{IronPython.Runtime.Method}	IronPython.Runtime.Method
		type	0	System.Int32
		windExposure	"WindExposed"	System.String""")
panel_8 = Panel("""{IronPython.Runtime.PythonDictionary}
"..."
{IronPython.Runtime.Method}
"__main__"
{IronPython.Runtime.Method}
{IronPython.Runtime.Method}
180
{Origin=0,-0.5,0.125 XAxis=0,0,-1, YAxis=1,0,0, ZAxis=0,-1,0}
"Outdoors"
{IronPython.NewTypes.System.Object_2$2}
{IronPython.Runtime.Method}
{0,-0.5,0.125}
{IronPython.Runtime.Method}
{IronPython.Runtime.Method}
{IronPython.Runtime.List}
{IronPython.Runtime.PythonDictionary}
{IronPython.Runtime.Method}
"Exterior Wall"
false
{IronPython.Runtime.Method}
"Exterior Wall"
{IronPython.Runtime.Method}
{IronPython.Runtime.Method}
{IronPython.Runtime.Method}
{IronPython.Runtime.Method}
{Rhino.Geometry.Brep}
{IronPython.Runtime.Method}
{IronPython.Runtime.Method}
{IronPython.Runtime.Method}
{IronPython.Runtime.Method}
{IronPython.Runtime.Method}
{IronPython.Runtime.Method}
{IronPython.Runtime.Method}
{IronPython.Runtime.Method}
"autocalculate"
true
false
"0b5329ec-d4c9-426f-aa2a-0b52a1af820c"
{IronPython.Runtime.PythonDictionary}
{IronPython.Runtime.Method}
false
{IronPython.Runtime.Method}
true
{IronPython.Runtime.Method}
{IronPython.Runtime.Method}
{IronPython.Runtime.Method}
{Rhino.Geometry.Mesh}
"zone_0_Srf_0"
{0,-1,0}
0
"autocalculate"
"HBSurface"
{IronPython.Runtime.Types.PythonType}
{IronPython.NewTypes.System.Object_2$2}
{Rhino.Geometry.Brep}
{IronPython.Runtime.List}
{IronPython.Runtime.Method}
{IronPython.Runtime.Method}
{IronPython.Runtime.Method}
{IronPython.Runtime.Method}
{IronPython.Runtime.Method}
{IronPython.Runtime.Method}
{IronPython.Runtime.Method}
{IronPython.Runtime.Method}
{IronPython.Runtime.Method}
{IronPython.Runtime.Method}
{IronPython.Runtime.Method}
{IronPython.Runtime.Method}
{IronPython.Runtime.List}
{IronPython.Runtime.PythonDictionary}
false
{IronPython.Runtime.PythonDictionary}
{IronPython.Runtime.PythonDictionary}
false
{IronPython.Runtime.PythonDictionary}
"SunExposed"
{IronPython.Runtime.Method}
0
"WindExposed"
""")
c_script_3 = CSharpScript(x=panel_7, y=panel_8)  # -> out, A, B; inputs x: String, y: String
# ---------- c_script_3: C# ----------
    //var properties = x.Substring(1, x.IndexOf("Key") - 1);
    var properties = x;
    var splitAt = properties.IndexOf(y);
    A = properties.Substring(0, splitAt) + "," + properties.Substring(splitAt,y.Length) + "," + properties.Substring(splitAt + y.Length);
# ---------- end c_script_3 ----------
panel_9 = Panel(c_script_3.A)
