# Grasshopper definition 04_ExtractPts.gh (Grasshopper 0.9.76)
# plug-ins: Python Interpreter, PassiveBee

toggle = BooleanToggle(True)
box = DomainBox(Base=PlaneXY(0, 0, 0), X=Domain(-2, 2), Y=Domain(-0.5, 0.5), Z=Domain(0, 0.25))
box_2 = DomainBox(Base=PlaneXY(0, 0, 0), X=Domain(0, 5), Y=Domain(0, 8), Z=Domain(0, 3))
honeybee = Honeybee_Honeybee()  # -> Vviiiiiiiiiizzz; plug-in component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
ladybug = Ladybug_Ladybug()  # -> Vviiiiiiiiiizzz; plug-in component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
mass2zone = Honeybee_Masses2Zones(zoneMasses=flatten(box_2), isConditioned=True, maxRoofAngle=30, createHBZones=toggle)  # -> readMe, HBZones; plug-in component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
panel = Panel(ladybug)
glazingcreator = Honeybee_GlazingBasedOnRatio(HBObjects=mass2zone.HBZones, glzRatio=Slider(0.8, range=0..1), runIt=toggle)  # -> readMe, HBObjWGLZ; plug-in component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
passivebeenickname = PassiveBee()  # -> Out, Json, Srfs
partition = PartitionList(List=passivebeenickname.Srfs, Size=4)
points = PointList(Points=passivebeenickname.Srfs, Size=0.5)
bang = ExplodeTree(Data=partition)  # -> Branch0, Branch1
pline = PolyLine(Vertices=bang.Branch0, Closed=False)
panel_2 = Panel(passivebeenickname.Srfs)
