# Grasshopper definition prototype.gh (Grasshopper 0.9.76)
# plug-ins: PassiveBee

# ---- group: Wall
brep = Brep(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)

# ---- group: Windows
brep_2 = Brep([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])

# ----
type = ValueList({"Opaque": "Opaque;", "Transparent": "Transparent;"}, selected="Transparent")
type_2 = ValueList({"Opaque": "Opaque;", "Transparent": "Transparent;"}, selected="Opaque")
wires = BrepWireframe(Brep=brep, Density=-1)
file = ReadFile(File="C:\Users\Mingbo\Documents\GitHub\PassiveBee.Grasshopper\doc\box.wps", PerLineParse=True)
psvobj = PsvObj(B=brep, tpye=type_2)
psvobj_2 = PsvObj(B=brep_2, tpye=type)
panel = Panel(file)
psvexporter = PsvExporter(_0_x=psvobj, _1_x=psvobj_2)
out = Data(psvexporter)
panel_2 = Panel(out)
item = ListItem(List=panel, Index=0, Wrap=True)
passivebeenickname = PassiveBee()
panel_3 = Panel(item)
merge = Merge()

# ==== cluster PsvObj
B = ClusterInput()
debrep = DeconstructBrep(Brep=B)  # -> Faces, Edges, Vertices
tpye = ClusterInput()
wires = BrepWireframe(Brep=debrep.Faces, Density=-1)
smesh = SimpleMesh(Brep=debrep.Faces)
tpye_2 = Data(tpye)
join = JoinCurves(Curves=wires, Preserve=False)
simplify = SimplifyCurve(Curve=join)  # -> Curve, Simplified
concat = Concatenate(FragmentA=tpye_2, FragmentB="Zone 1;Outer air;")
facen = FaceNormals(Mesh=smesh)  # -> Centers, Normals
explode = Explode(Curve=simplify.Curve, Recursive=True)  # -> Segments, Vertices
panel = Panel(concat)
cull_i = CullIndex(List=explode.Vertices, Indices=-1, Wrap=True)
pshift = ShiftPaths(Data=cull_i, Offset=-3)
pt = Point(pshift)
vec = Vector(facen.Normals)
merge = Merge(Data1=vec, Data2=pt)
lng = ListLength(List=pt)

rep = ReplaceText(Text=merge, Find="{", RecursiveReplace=False)
rep_2 = ReplaceText(Text=rep, Find="}", RecursiveReplace=False)
rep_3 = ReplaceText(Text=rep_2, Find=",", Replace=";", RecursiveReplace=False)

panel_2 = Panel(merge)
ins = InsertItems(List=rep_3, Item=lng, Indices=1, Wrap=True)
ins_2 = InsertItems(List=ins, Item="1", Indices=1, Wrap=True)
panel_3 = Panel(ins)
panel_4 = Panel(ins_2)
ins_3 = InsertItems(List=ins_2, Item=panel, Indices=Slider(0, range=0..100), Wrap=True)  # -> simplify(List)
tstat = TreeStatistics(Tree=ins_3)  # -> Paths, Length, Count
equals = Equality(FirstNumber=tstat.Count, SecondNumber=1)  # -> Equality, Inequality
filter = StreamFilter(Gate=equals.Equality, Stream0=simplify(ins_3), Stream1=flatten(ins_3))
s_0 = ClusterOutput(filter)

# ==== cluster PsvExporter
_0_x = ClusterInput()
_1_x = ClusterInput()
entwine = Entwine(Branch0X=_0_x, Branch1X=_1_x, FlattenInputs=False)
lng = ListLength(List=entwine)  # -> flatten(Length)
partition = PartitionList(List=flatten(entwine), Size=lng)  # -> simplify(Chunks)
tstat = TreeStatistics(Tree=partition)  # -> Paths, Length, Count
split = SplitList(List=partition, Index=2)  # -> ListA, ListB
dpath = DeconstructPath(Branch=tstat.Paths)
addition = Addition(A=dpath, B=1)
item = ListItem(List=split.ListA, Index=0, Wrap=True)  # -> Item, Item1
concat = Concatenate(FragmentA=item.Item, FragmentB=addition, FragmentC=";", FragmentD=item.Item1)
merge = Merge(Data1=concat, Data2=split.ListB)  # -> flatten(Result)
total_srf_number = Panel(tstat.Count)
panel = Panel("""WUFIplus geometric data exported from SketchUp
1""")
merge_2 = Merge(Data1=panel, Data2=total_srf_number, Data3=merge)
R = ClusterOutput(merge_2)
